# Grasshopper definition 3DSketchInsights.gh (Grasshopper 1.0.7)

panel = Panel("""-30.8360137939453 
-37.0273590087891 
0 
-33.9387654072633 
-35.6246712444618 
0 
-39.8851589692472 
-32.9364336635135 
0 
-34.3737362527004 
-27.115243718897 
0 
-37.0816155216371 
-24.2370128083299 
0 
-38.3709259033203 
-22.8665924072266 
0 """)
panel_2 = Panel("""0 
0 
0 
0 
0.363706316211091 
0.697039649544424 
1 
1 
1 
1 """)
panel_3 = Panel("""0 
0 
0 
0 
0 
0 """)
numbers_to_points = NumbersToPoints(Numbers=panel, Mask=4)
list_length = ListLength(List=panel_2)
subtraction = Subtraction(A=list_length, B=1)
merge = Merge(Data1=0, Data2=subtraction)
cull_index = CullIndex(List=panel_2, Indices=merge, Wrap=True)
panel_4 = Panel(numbers_to_points)
panel_5 = Panel(cull_index)
nurbs_curve_pwk = NurbsCurvePWK(Points=numbers_to_points, Weights=panel_3, Knots=cull_index)  # -> Curve, Length, Domain
