# Dynamo graph Home2.19.dyn (Dynamo 2.19.0.5742)

file_path = Filename("plate\f6732c19-1a6b-47ac-a1d0-c58a1e083491-AD_LINE.txt")
file_from_path = FileObject(path=file_path)
readText = FileSystem.ReadText(file=file_from_path)
watch = Watch(readText)
