# Grasshopper definition SketchInsights.gh (Grasshopper 1.0.7)

panel = Panel("C:\Users\steph\Desktop\SketchInsights\plate\3da8b49e-59d2-4ba2-a8f1-1b858eee2ec5-AD_POINT.txt")
read_file = ReadFile(File=panel, PerLineParse=True)
panel_2 = Panel("""0
1
2
3""")
panel_3 = Panel(read_file)
list_item = ListItem(List=read_file, Index=panel_2, Wrap=True)
text_split = TextSplit(Text=list_item, Separators=":")
replace_text = ReplaceText(Text=text_split, Find=" ", RecursiveReplace=False)
panel_4 = Panel(replace_text)
flatten_tree = FlattenTree(Tree=replace_text, Path="{0}")
panel_5 = Panel("""X
Y""")
replace_text_2 = ReplaceText(Text=flatten_tree, Find=panel_5, RecursiveReplace=False)
panel_6 = Panel(replace_text_2)

panel_7 = Panel("C:\Users\steph\Desktop\SketchInsights\test-model-for-code\ba3dfc73-95e9-4de0-beb5-57ecb25db39e-AD_BSPLINE.txt")
series = Series(Start="0", Step="2", Count="4")

series_2 = Series(Start="0", Step="2", Count="4")
cull_index = CullIndex(List=flatten_tree, Indices=series_2, Wrap=True)
panel_8 = Panel(cull_index)
list_item_2 = ListItem(List=cull_index, Index="0", Wrap=True)
list_item_3 = ListItem(List=cull_index, Index="1", Wrap=True)
construct_point = ConstructPoint(XCoordinate=list_item_2, YCoordinate=list_item_3, ZCoordinate=0)

read_file_2 = ReadFile(File=panel_7, PerLineParse=True)
panel_9 = Panel("""0
2
4
6""")
panel_10 = Panel("""C:\Users\steph\Desktop\SketchInsights\plate\e8be53f3-4f8c-4236-b7f8-2f27ee0f4e54-AD_LINE.txt
C:\Users\steph\Desktop\SketchInsights\plate\c0eab692-1c4e-40e3-9b9b-47a81b730d8f-AD_LINE.txt
C:\Users\steph\Desktop\SketchInsights\plate\7f7ffdb6-a546-4a52-a8cd-bf6f4d4d2f39-AD_LINE.txt
C:\Users\steph\Desktop\SketchInsights\plate\875daf8e-0e26-43fa-8395-b737ec63fd5b-AD_LINE.txt
C:\Users\steph\Desktop\SketchInsights\plate\dcbbdbb9-7caa-474f-a658-b26c2bef901c-AD_LINE.txt
C:\Users\steph\Desktop\SketchInsights\plate\904f1df7-5278-41db-90e2-2089617f5c3e-AD_LINE.txt
C:\Users\steph\Desktop\SketchInsights\plate\c8020a35-26f2-4fc0-8e9b-916faa740588-AD_LINE.txt""")
number_slider = Slider(2, range=0..100)
panel_11 = Panel(read_file_2)
panel_12 = Panel("1")
file_path = FilePath()
panel_13 = Panel("C:\Users\steph\Desktop\SketchInsights\plate\98b21d93-7daf-4729-8dfb-ec523a8865cc-AD_LINE.txt")
panel_14 = Panel("""0
1
2
3""")
sequence = Sequence(Notation="[N-1] + [N-2]", Length=20, Initial=[1, 1])
list_item_4 = ListItem(List=read_file_2, Index=panel_14, Wrap=True)
range = Range(Domain=Domain(0, 1), Steps=10)
text_split_2 = TextSplit(Text=list_item_4, Separators=":")
panel_15 = Panel("C:\Users\steph\Desktop\SketchInsights\plate\98b21d93-7daf-4729-8dfb-ec523a8865cc-AD_LINE.txt")
replace_text_3 = ReplaceText(Text=text_split_2, Find=" ", RecursiveReplace=False)
panel_16 = Panel(replace_text_3)
read_file_3 = ReadFile(File=panel_10, PerLineParse=True)
read_file_4 = ReadFile(File=panel_15, PerLineParse=True)
flatten_tree_2 = FlattenTree(Tree=replace_text_3, Path="{0}")
panel_17 = Panel(read_file_3)
panel_18 = Panel("""0
1
2
3""")
list_item_5 = ListItem(List=read_file_3, Index=panel_18, Wrap=True)
text_split_3 = TextSplit(Text=list_item_5, Separators=":")
panel_19 = Panel(read_file_4)
panel_20 = Panel("""0
1
2
3""")
replace_text_4 = ReplaceText(Text=text_split_3, Find=" ", RecursiveReplace=False)
series_3 = Series(Start="0", Step="2", Count="4")
series_4 = Series(Start="0", Step="2", Count="51")
list_item_6 = ListItem(List=read_file_4, Index=panel_20, Wrap=True)
text_split_4 = TextSplit(Text=list_item_6, Separators=":")
cull_index_2 = CullIndex(List=flatten_tree_2, Indices=series_3, Wrap=True)
panel_21 = Panel(cull_index_2)
flatten_tree_3 = FlattenTree(Tree=replace_text_4, Path="{0}")
replace_text_5 = ReplaceText(Text=text_split_4, Find=" ", RecursiveReplace=False)
panel_22 = Panel("""X1
Y1
X2
Y2""")
list_item_7 = ListItem(List=cull_index_2, Index=Slider(0, range=0..100), Wrap=True)
panel_23 = Panel(list_item_7)
flatten_tree_4 = FlattenTree(Tree=replace_text_5, Path="{0}")
replace_text_6 = ReplaceText(Text=flatten_tree_3, Find=panel_22, RecursiveReplace=False)
cull_index_3 = CullIndex(List=flatten_tree_3, Indices=series_4, Wrap=True)
panel_24 = Panel(replace_text_6)
panel_25 = Panel("""0
2
4
6""")
cull_index_4 = CullIndex(List=flatten_tree_4, Indices=panel_25, Wrap=True)
numbers_to_points = NumbersToPoints(Numbers=cull_index_4, Mask=2)
round = Round(Number=cull_index_3)  # -> Nearest, Floor, Ceiling
panel_26 = Panel(round.Floor)
list_item_8 = ListItem(List=numbers_to_points, Index="0", Wrap=True)
fit_line = FitLine(Points=numbers_to_points)
list_item_9 = ListItem(List=numbers_to_points, Index="1", Wrap=True)
numbers_to_points_2 = NumbersToPoints(Numbers=cull_index_3, Mask=2)
partition_list = PartitionList(List=cull_index_3, Size=4)  # -> simplify(Chunks)

list_item_10 = ListItem(List=cull_index_2, Index=Slider(3, range=0..100), Wrap=True)
panel_27 = Panel(list_item_10)
text_split_5 = TextSplit(Text=list_item_10, Separators=",")
panel_28 = Panel(text_split_5)

list_item_11 = ListItem(List=cull_index_2, Index=Slider(2, range=0..100), Wrap=True)
panel_29 = Panel(list_item_11)
text_split_6 = TextSplit(Text=list_item_11, Separators=",")
panel_30 = Panel(text_split_6)

panel_31 = Panel(round.Ceiling)
line = Line(StartPoint=list_item_8, EndPoint=list_item_9)
panel_32 = Panel(partition_list)
panel_33 = Panel(cull_index_3)
panel_34 = Panel(round.Nearest)
cull_duplicates = CullDuplicates(Points=numbers_to_points_2, Tolerance=0.1, CullMode=3)  # -> Points, Indices, Valence
list_item_12 = ListItem(List=numbers_to_points_2, Index="0", Wrap=True)
list_item_13 = ListItem(List=numbers_to_points_2, Index="1", Wrap=True)
panel_35 = Panel(numbers_to_points)
line_2 = Line(StartPoint=list_item_12, EndPoint=list_item_13)
text_split_7 = TextSplit(Text=list_item_7, Separators=",")
point = Point(cull_duplicates.Points)
panel_36 = Panel(numbers_to_points_2)
number_slider_2 = Slider(0, range=0..100)
sort_points = SortPoints(Points=point)  # -> Points, Indices
panel_37 = Panel(sort_points.Points)
polyline = PolyLine(Vertices=point, Closed=False)  # disabled
panel_38 = Panel("""0
1
2
3""")
partition_list_2 = PartitionList(List=text_split_7, Size=2)
list_item_14 = ListItem(List=partition_list, Index=panel_38, Wrap=True)
panel_39 = Panel(partition_list_2)
list_item_15 = ListItem(List=list_item_14, Index="0", Wrap=True)
list_item_16 = ListItem(List=list_item_14, Index="1", Wrap=True)
list_item_17 = ListItem(List=list_item_14, Index="2", Wrap=True)
list_item_18 = ListItem(List=list_item_14, Index="3", Wrap=True)
panel_40 = Panel(list_item_14)
construct_point_2 = ConstructPoint(XCoordinate=list_item_15, YCoordinate=list_item_16, ZCoordinate=0)
construct_point_3 = ConstructPoint(XCoordinate=list_item_17, YCoordinate=list_item_18, ZCoordinate=0)
list_item_19 = ListItem(List=partition_list_2, Index="1", Wrap=True)
list_item_20 = ListItem(List=partition_list_2, Index="0", Wrap=True)
line_3 = Line(StartPoint=construct_point_2, EndPoint=construct_point_3)
construct_point_4 = ConstructPoint(XCoordinate=list_item_20, YCoordinate=list_item_19, ZCoordinate=0)  # -> flatten(Point)
panel_41 = Panel(line_3)
polyline_2 = PolyLine(Vertices=construct_point_4, Closed=invert(False))
nurbs_curve = NurbsCurve(Vertices=construct_point_4, Degree=3, Periodic=False)  # -> Curve, Length, Domain
nurbs_curve_2 = NurbsCurve(Vertices=construct_point_4, Degree=3, Periodic=invert(False))  # -> Curve, Length, Domain
interpolate = Interpolate(Vertices=construct_point_4, Degree=3, Periodic=False, KnotStyle=2)  # -> Curve, Length, Domain
polyline_3 = PolyLine(Vertices=construct_point_4, Closed=False)
end_points = EndPoints(Curve=nurbs_curve.Curve)  # -> Start, End
line_4 = Line(StartPoint=end_points.Start, EndPoint=end_points.End)
panel_42 = Panel(construct_point_4)
curve = Curve([nurbs_curve.Curve, line_4])

panel_43 = Panel("""0
20""")
cull_index_5 = CullIndex(List=text_split_6, Indices=panel_43, Wrap=True)
panel_44 = Panel(cull_index_5)

switch_between_the_default_list_and_the = BooleanToggle(True)  # "Switch Between the Default List and the Cull List"
stream_filter = StreamFilter(Gate=switch_between_the_default_list_and_the, Stream0=text_split_6, Stream1=cull_index_5)

panel_45 = Panel(stream_filter)

nurbs_curve_pwk = NurbsCurvePWK(Points=construct_point_4, Weights=text_split_5, Knots=stream_filter)  # -> Curve, Length, Domain
control_points = ControlPoints(Curve=nurbs_curve_pwk.Curve)  # -> Points, Weights, Knots
custom_preview = CustomPreview(Geometry=nurbs_curve_pwk.Curve, Material=ColourSwatch(SwatchColor=RGB(255, 255, 255)))
